# Grasshopper definition Melbourne.ghx (Grasshopper 1.0.7)
# plug-ins: Caribou, PancakeContract

path = FilePath("Z:\Sites\Caribou\Caribou.Tests\Cases\melbourne.osm.xml")
file = ReadFile(File=path, PerLineParse=False)
osm = OpenStreetMap(OSMXML=file)  # -> Ways, Nodes, Debug
panel = Panel(osm.Debug)
asidentical = AssertIdentical()  # -> Satisfied, ExtraInfo; disabled
